# Dynamo graph Clash Ball Insert_Revit2019.dyn (Dynamo 1.3.4.6666)

# group: Read from Excel
input_file_select = Filename("..\..\..\..\Clash Data_Template.xlsx")
fromPath = FileObject(input_file_select)  # "File.FromPath"
file_sheet_name = StringInput("Sheet1")
boolean = BoolSelector(true)
readFromFile = Excel.ReadFromFile(file=fromPath, sheetName=file_sheet_name, readAsStrings=boolean)

deconstruct = List.Deconstruct(list=readFromFile, lacing=Longest)
restOfItems = List.RestOfItems(deconstruct.rest)
code_block = CodeBlock { 2; }
code_block_2 = CodeBlock { 1; }
takeEveryNthItem = List.TakeEveryNthItem(restOfItems, code_block, code_block_2)

# group: X,Y,Z Coordinates from Navis
code_block_3 = CodeBlock { 0; }
getItemAtIndex = List.GetItemAtIndex(list=takeEveryNthItem, index=code_block_3, lacing=CrossProduct)
toNumber = String.ToNumber(getItemAtIndex)
convert_between_units = DynamoConvert(toNumber, conversionMetric=Length, conversionFrom=Meters, conversionTo=Millimeters)
code_block_4 = CodeBlock { 1; }
getItemAtIndex_2 = List.GetItemAtIndex(list=takeEveryNthItem, index=code_block_4, lacing=CrossProduct)
toNumber_2 = String.ToNumber(getItemAtIndex_2)
convert_between_units_2 = DynamoConvert(toNumber_2, conversionMetric=Length, conversionFrom=Meters, conversionTo=Millimeters)
code_block_5 = CodeBlock { 2; }
getItemAtIndex_3 = List.GetItemAtIndex(list=takeEveryNthItem, index=code_block_5, lacing=CrossProduct)
toNumber_3 = String.ToNumber(getItemAtIndex_3)
convert_between_units_3 = DynamoConvert(toNumber_3, conversionMetric=Length, conversionFrom=Meters, conversionTo=Millimeters)

# group: Get True North Angle and Convert Degrees to Radians
categories = Categories("ProjectBasePoint")
all_elements_of_category = ElementsOfCategory(categories)
string = StringInput("Angle to True North")
getParameterValueByName = Element.GetParameterValueByName(element=all_elements_of_category, parameterName=string)
watch = Watch(getParameterValueByName)
cos = Math.Cos(watch)
sin = Math.Sin(watch)
degreesToRadians = Math.DegreesToRadians(watch)

# group: Re-Calculate X, Y coordinates
mul = convert_between_units@L2 * cos
mul_2 = convert_between_units_2@L2 * sin
sub = mul - mul_2
mul_3 = convert_between_units@L2 * sin
mul_4 = convert_between_units_2@L2 * cos
add = mul_3 + mul_4

# group: Create Clash Ball
clash_sphere_family_select = FamilyTypes("Clash Ball (Parameter):Clash Ball (Parameter)")
byCoordinates = Point.ByCoordinates(x=sub, y=add, z=convert_between_units_3)
byPoint = FamilyInstance.ByPoint(familyType=clash_sphere_family_select, point=byCoordinates)

# group: Insert Date to Parameter
code_block_6 = CodeBlock { "Clash Detection_Date"; }
code_block_7 = CodeBlock { "-"; }
code_block_8 = CodeBlock { 4; }
getItemAtIndex_4 = List.GetItemAtIndex(list=takeEveryNthItem, index=code_block_8, lacing=CrossProduct)
code_block_9 = CodeBlock { 5; }
getItemAtIndex_5 = List.GetItemAtIndex(list=takeEveryNthItem, index=code_block_9, lacing=CrossProduct)
code_block_10 = CodeBlock { 6; }
getItemAtIndex_6 = List.GetItemAtIndex(list=takeEveryNthItem, index=code_block_10, lacing=CrossProduct)
create = List.Create(getItemAtIndex_4, getItemAtIndex_5, getItemAtIndex_6)
transpose = List.Transpose(create)
flatten = Flatten(transpose@L3)
join = String.Join(code_block_7, flatten)
transpose_2 = List.Transpose(join)
setParameterByName = Element.SetParameterByName(element=byPoint, parameterName=code_block_6, value=transpose_2)

# group: Insert Grid Location to Parameter
code_block_11 = CodeBlock { "Grid Location"; }
code_block_12 = CodeBlock { 3; }
getItemAtIndex_7 = List.GetItemAtIndex(list=takeEveryNthItem, index=code_block_12, lacing=CrossProduct)
code_block_13 = CodeBlock { " "; }
split = String.Split(getItemAtIndex_7, code_block_13)
firstItem = List.FirstItem(split@@L2)
setParameterByName_2 = Element.SetParameterByName(element=byPoint, parameterName=code_block_11, value=firstItem)

# group: Insert Clash Number to Parameter
code_block_14 = CodeBlock { "Clash Number"; }
firstItem_2 = List.FirstItem(deconstruct.first@L1)
code_block_15 = CodeBlock { 1; }
dropItems = List.DropItems(list=firstItem_2, amount=code_block_15)
code_block_16 = CodeBlock { 2; }
code_block_17 = CodeBlock { 1; }
takeEveryNthItem_2 = List.TakeEveryNthItem(dropItems, code_block_16, code_block_17)
setParameterByName_3 = Element.SetParameterByName(element=byPoint, parameterName=code_block_14, value=takeEveryNthItem_2)
