# Dynamo graph Clash Ball Insert_Revit2022.dyn (Dynamo 2.10.1.3976)

# group: Read from Excel
input_file_select = Filename("..\2020.11.25_STR vs MEP(Test).xlsx")  # graph input
fromPath = FileObject(path=input_file_select)  # "File.FromPath"
file_sheet_name = StringInput("Sheet1")
boolean = BoolSelector(true)
importExcel = Data.ImportExcel(file=fromPath, sheetName=file_sheet_name, readAsStrings=boolean)

deconstruct = List.Deconstruct(list=importExcel, lacing=Longest)
restOfItems = List.RestOfItems(list=deconstruct.rest)
code_block = CodeBlock { 2; }
code_block_2 = CodeBlock { 1; }
takeEveryNthItem = List.TakeEveryNthItem(list=restOfItems, n=code_block, offset=code_block_2)

# group: X,Y,Z Coordinates from Navis
code_block_3 = CodeBlock { 0; }
getItemAtIndex = List.GetItemAtIndex(list=takeEveryNthItem, index=code_block_3, lacing=CrossProduct)
toNumber = String.ToNumber(str=getItemAtIndex)
convert_between_units = DynamoConvert(toNumber, MeasurementType="Length", FromConversion="Meters", ToConversion="Millimeters")
code_block_4 = CodeBlock { 1; }
getItemAtIndex_2 = List.GetItemAtIndex(list=takeEveryNthItem, index=code_block_4, lacing=CrossProduct)
toNumber_2 = String.ToNumber(str=getItemAtIndex_2)
convert_between_units_2 = DynamoConvert(toNumber_2, MeasurementType="Length", FromConversion="Meters", ToConversion="Millimeters")
code_block_5 = CodeBlock { 2; }
getItemAtIndex_3 = List.GetItemAtIndex(list=takeEveryNthItem, index=code_block_5, lacing=CrossProduct)
toNumber_3 = String.ToNumber(str=getItemAtIndex_3)
convert_between_units_3 = DynamoConvert(toNumber_3, MeasurementType="Length", FromConversion="Meters", ToConversion="Millimeters")

# group: Get True North Angle and Convert Degrees to Radians
categories = Categories("OST_ProjectBasePoint")
all_elements_of_category = ElementsOfCategory(Category=categories)
string = StringInput("Angle to True North")
getParameterValueByName = Element.GetParameterValueByName(element=all_elements_of_category, parameterName=string)
watch = Watch(getParameterValueByName)
cos = Math.Cos(angle=watch)
sin = Math.Sin(angle=watch)
degreesToRadians = Math.DegreesToRadians(degrees=watch)

# group: Re-Calculate X, Y coordinates
mul = convert_between_units * cos  # lacing=Longest
mul_2 = convert_between_units_2 * sin  # lacing=Longest
sub = mul - mul_2
mul_3 = convert_between_units * sin  # lacing=Longest
mul_4 = convert_between_units_2 * cos  # lacing=Longest
add = mul_3 + mul_4

# group: Create Clash Ball
clash_sphere_family_select = FamilyTypes("Clash Ball (Parameter)_Revit2022:Clash Ball (Parameter)_Revit2022")  # graph input
byCoordinates = Point.ByCoordinates(x=sub, y=add, z=convert_between_units_3)
byPoint = FamilyInstance.ByPoint(familyType=clash_sphere_family_select, point=byCoordinates)

# group: Insert Date to Parameter
code_block_6 = CodeBlock { "Clash Detection_Date"; }
code_block_7 = CodeBlock { "-"; }
code_block_8 = CodeBlock { 4; }
getItemAtIndex_4 = List.GetItemAtIndex(list=takeEveryNthItem, index=code_block_8, lacing=CrossProduct)
code_block_9 = CodeBlock { 5; }
getItemAtIndex_5 = List.GetItemAtIndex(list=takeEveryNthItem, index=code_block_9, lacing=CrossProduct)
code_block_10 = CodeBlock { 6; }
getItemAtIndex_6 = List.GetItemAtIndex(list=takeEveryNthItem, index=code_block_10, lacing=CrossProduct)
create = List.Create(item0=getItemAtIndex_4, item1=getItemAtIndex_5, item2=getItemAtIndex_6)
transpose = List.Transpose(lists=create)
join = String.Join(separator=code_block_7, string0=transpose, lacing=Longest)
transpose_2 = List.Transpose(lists=join)
setParameterByName = Element.SetParameterByName(element=byPoint, parameterName=code_block_6, value=transpose_2)

# group: Insert Grid Location to Parameter
code_block_11 = CodeBlock { "Grid Location"; }
code_block_12 = CodeBlock { 3; }
getItemAtIndex_7 = List.GetItemAtIndex(list=takeEveryNthItem, index=code_block_12, lacing=CrossProduct)
code_block_13 = CodeBlock { " "; }
split = String.Split(str=getItemAtIndex_7, separator0=code_block_13)
firstItem = List.FirstItem(list=split@@L2)
setParameterByName_2 = Element.SetParameterByName(element=byPoint, parameterName=code_block_11, value=firstItem)

# group: Insert Clash Number to Parameter
code_block_14 = CodeBlock { "Clash Number"; }
firstItem_2 = List.FirstItem(list=deconstruct.first@L1)
code_block_15 = CodeBlock { 1; }
dropItems = List.DropItems(list=firstItem_2, amount=code_block_15)
code_block_16 = CodeBlock { 2; }
code_block_17 = CodeBlock { 1; }
takeEveryNthItem_2 = List.TakeEveryNthItem(list=dropItems, n=code_block_16, offset=code_block_17)
setParameterByName_3 = Element.SetParameterByName(element=byPoint, parameterName=code_block_14, value=takeEveryNthItem_2)
